# Grasshopper definition BIMSC_Orbit_Webapp_c_sim.gh (Grasshopper 1.0.7)

working = GetNumber(Slider(10, range=1..50), AtLeast=1, AtMost=1, Maximum=50, Minimum=1)
population_of_modules = GetNumber(Slider(5, range=1..20), AtLeast=1, AtMost=1, Maximum=1.797693135e+308, Minimum=-1.797693135e+308)
recompute = GetBoolean(Button(), AtLeast=1, AtMost=1, FalseValue="False", TrueValue="True")
living_octa_1 = GetNumber(Slider(5, range=1..50), AtLeast=1, AtMost=1, Maximum=50, Minimum=1)
living_octa_2 = GetNumber(Slider(3, range=1..50), AtLeast=1, AtMost=1, Maximum=50, Minimum=1)
sport_rec_1 = GetNumber(Slider(20, range=1..50), AtLeast=1, AtMost=1, Maximum=50, Minimum=1)
greenhouse_1 = GetNumber(Slider(15, range=1..50), AtLeast=1, AtMost=1, Maximum=50, Minimum=1)
bridge = GetNumber(Slider(12, range=1..50), AtLeast=1, AtMost=1, Maximum=50, Minimum=1)
core = GetNumber(Slider(8, range=1..50), AtLeast=1, AtMost=1, Maximum=50, Minimum=1)
single = GetNumber(Slider(20, range=1..50), AtLeast=1, AtMost=1, Maximum=50, Minimum=1, Prompt="Single")
merge = Merge(
    Data1=living_octa_1,
    Data2=living_octa_2,
    Data4=sport_rec_1,
    Data5=sport_rec_1,
    Data7=greenhouse_1,
    Data8=working,
    Data9=single,
    Data10=bridge,
    Data11=core)
panel = Panel(merge)
data = Data(merge)
geo = Geometry(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)

# ----
# Living
# Module
# 2 Octa
# 2
panel_2 = Panel("""LM_2
LM_2
LM_2
LM_2
LM_2
LM_2
LM_2
LM_2
LM_2
LM_2
LM_2
LM_2""")
geo_2 = Geometry(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)
pt = Point([Point(5, -19, 4), Point(9, -15, 4), Point(5, -11, 4), Point(1, -15, 4), Point(5, -15, 8), Point(5, -15, 0), Point(1, -23, 8), Point(5, -19, 8), Point(1, -15, 8), Point(-3, -19, 8), Point(1, -19, 12), Point(1, -19, 4)])
crv = Curve([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])
conndir = Wasp_ConnectionFromDirection(GEO=geo_2, CEN=pt, UP=crv, T=panel_2)  # -> CONN, PLN_OUT; inputs CEN: list of Point3d, UP: list of Curve, T: list; plug-in component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
attribute = Wasp_Attribute(ID="LIVING2", VAL=geo, TR=Toggle(True))  # -> ATTR; inputs VAL: list, TR: Boolean; plug-in component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
part = Wasp_BasicPart(NAME="LM_2", GEO=geo_2, CONN=flatten(conndir.CONN), ATTR=attribute)  # -> PART; inputs GEO: Mesh, CONN: list, ATTR: list; plug-in component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

geo_3 = Geometry(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)

# ----
# Living
# Module
# 1 Octa
# 1
geo_4 = Geometry(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)
pt_2 = Point([Point(5, 1, 4), Point(9, 5, 4), Point(5, 9, 4), Point(1, 5, 4), Point(5, 5, 8), Point(5, 5, 0)])
crv_2 = Curve([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])
panel_3 = Panel("""LM_1
LM_1
LM_1
LM_1
LM_1
LM_1""")
conndir_2 = Wasp_ConnectionFromDirection(GEO=geo_4, CEN=pt_2, UP=crv_2, T=panel_3)  # -> CONN, PLN_OUT; inputs CEN: list of Point3d, UP: list of Curve, T: list; plug-in component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
attribute_2 = Wasp_Attribute(ID="LIVING1", VAL=geo_3, TR=Toggle(True))  # -> ATTR; inputs VAL: list, TR: Boolean; plug-in component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
part_2 = Wasp_BasicPart(NAME="LM_1", GEO=geo_4, CONN=flatten(conndir_2.CONN), ATTR=attribute_2)  # -> PART; inputs GEO: Mesh, CONN: list, ATTR: list; plug-in component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

# ----
# Guidelines
# Annotations
geo_5 = Geometry([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])
geo_6 = Geometry([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])
# Basic Simple Aggregation v.02
# 
#      • 03-11-22 - Neil John Bersabe
# • 3-22-22 - Neil John Bersabe
preview = CustomPreview(Geometry=geo_5, Material=ColourSwatch(SwatchColor=RGB(110, 255, 0)))
preview_2 = CustomPreview(Geometry=geo_6, Material=ColourSwatch(SwatchColor=RGB(255, 0, 85)))

geometry = Geometry(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)

# ----
# 5
# Sport & Rec Module 2
pt_3 = Point([Point(41, -15, 4), Point(49, -15, 4), Point(45, -15, 8)])
panel_4 = Panel("""SRM_2A
SRM_2A
SRM_2B""")
geo_7 = Geometry(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)
crv_3 = Curve([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])
conndir_3 = Wasp_ConnectionFromDirection(GEO=geo_7, CEN=pt_3, UP=crv_3, T=panel_4)  # -> CONN, PLN_OUT; inputs CEN: list of Point3d, UP: list of Curve, T: list; plug-in component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
attribute_3 = Wasp_Attribute(ID="SPORTREC2", VAL=geometry, TR=Toggle(True))  # -> ATTR; inputs VAL: list, TR: Boolean; plug-in component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
part_3 = Wasp_BasicPart(NAME="SRM_2", GEO=geo_7, CONN=flatten(conndir_3.CONN), ATTR=attribute_3)  # -> PART; inputs GEO: Mesh, CONN: list, ATTR: list; plug-in component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

geometry_2 = Geometry(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)

# ----
# 4
# Sport & Rec Module 1
panel_5 = Panel("""SRM_1A
SRM_1A""")
geo_8 = Geometry(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)
pt_4 = Point([Point(41, 5, 4), Point(49, 5, 4)])
crv_4 = Curve([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])
conndir_4 = Wasp_ConnectionFromDirection(GEO=geo_8, CEN=pt_4, UP=crv_4, T=panel_5)  # -> CONN, PLN_OUT; inputs CEN: list of Point3d, UP: list of Curve, T: list; plug-in component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
# MODULES
panel_6 = Panel("SRM_1")
attribute_4 = Wasp_Attribute(ID="SPORTREC1", VAL=geometry_2, TR=Toggle(True))  # -> ATTR; inputs VAL: list, TR: Boolean; plug-in component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
part_4 = Wasp_BasicPart(NAME=panel_6, GEO=geo_8, CONN=flatten(conndir_4.CONN), ATTR=attribute_4)  # -> PART; inputs GEO: Mesh, CONN: list, ATTR: list; plug-in component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

# ----
# Greenhouse
# Module 1
# 9
toggle = BooleanToggle(True)
geo_9 = Geometry(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)
pt_5 = Point([Point(85, 5, 0), Point(85, 5, 12)])
crv_5 = Curve([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])
panel_7 = Panel("""GH_1A
GH_1B""")
geo_10 = Geometry([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])
# WASP PART
# SMART ATTRIBUTES (CONDITIONALS)
panel_8 = Panel("GH_1")
attribute_5 = Wasp_Attribute(ID="GREENHOUSE1", VAL=geo_10, TR=toggle)  # -> ATTR; inputs VAL: list, TR: Boolean; plug-in component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
conndir_5 = Wasp_ConnectionFromDirection(GEO=geo_9, CEN=pt_5, UP=crv_5, T=panel_7)  # -> CONN, PLN_OUT; inputs CEN: list of Point3d, UP: list of Curve, T: list; plug-in component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
lng = ListLength(List=pt_5)
part_5 = Wasp_BasicPart(NAME=panel_8, GEO=geo_9, CONN=flatten(conndir_5.CONN), ATTR=attribute_5)  # -> PART; inputs GEO: Mesh, CONN: list, ATTR: list; plug-in component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
panel_9 = Panel(lng)

geometry_3 = Geometry(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)

# ----
# Working
# Module 1
# 12
toggle_2 = BooleanToggle(True)
geo_11 = Geometry(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)
pt_6 = Point([Point(125, 5.00437902, 8), Point(125, 5, 0), Point(125, 1, 4), Point(125, 9, 4)])
crv_6 = Curve([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])
panel_10 = Panel("""WM_1A
WM_1A
WM_1B
WM_1C""")
conndir_6 = Wasp_ConnectionFromDirection(GEO=geo_11, CEN=pt_6, UP=crv_6, T=panel_10)  # -> CONN, PLN_OUT; inputs CEN: list of Point3d, UP: list of Curve, T: list; plug-in component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
attribute_6 = Wasp_Attribute(ID="WORKING1", VAL=geometry_3, TR=toggle_2)  # -> ATTR; inputs VAL: list, TR: Boolean; plug-in component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
part_6 = Wasp_BasicPart(NAME="WM_1", GEO=geo_11, CONN=flatten(conndir_6.CONN), ATTR=attribute_6)  # -> PART; inputs GEO: Mesh, CONN: list, ATTR: list; plug-in component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
panel_11 = Panel("""WM_1
WM_1
WM_1
WM_1
WM_1
WM_1""")

geo_12 = Geometry(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)

# ----
# Infrastructure
# Bridge
# Module
# 15
geo_13 = Geometry(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)
panel_12 = Panel("""IM_A1
IM_A1
IM_A1
IM_A1
IM_A1
IM_A1
IM_A2
IM_A2
IM_A2
IM_A2
IM_A2
IM_A2
IM_A3
IM_A3
IM_A3
IM_A3
IM_A3
IM_A3
IM_Abot
IM_Abot
IM_Atop
IM_Atop""")
pt_7 = Point([Point(205, -19, 4), Point(201, -15, 4), Point(209, -15, 4), Point(205, -11, 4), Point(205, -15, 8), Point(205, -15, 0), Point(209, -15, 8), Point(205, -11, 8), Point(213, -11, 8), Point(209, -7, 8), Point(209, -11, 12), Point(209, -11, 4), Point(213, -11, 12), Point(209, -7, 12), Point(217, -7, 12), Point(213, -3, 12), Point(213, -7, 16), Point(213, -7, 8), Point(203, -17, 6), Point(203, -17, 2), Point(215, -5, 14), Point(215, -5, 10)])
crv_7 = Curve([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])
conndir_7 = Wasp_ConnectionFromDirection(GEO=geo_13, CEN=pt_7, UP=crv_7, T=panel_12)  # -> CONN, PLN_OUT; inputs CEN: list of Point3d, UP: list of Curve, T: list; plug-in component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
attribute_7 = Wasp_Attribute(ID="BRIDGE", VAL=geo_12, TR=Toggle(True))  # -> ATTR; inputs VAL: list, TR: Boolean; plug-in component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
part_7 = Wasp_BasicPart(NAME="IM_B", GEO=geo_13, CONN=flatten(conndir_7.CONN), ATTR=attribute_7)  # -> PART; inputs GEO: Mesh, CONN: list, ATTR: list; plug-in component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

geo_14 = Geometry(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)

# ----
# Infrastructure
# Core
# Module
# 16
panel_13 = Panel("""IM_C1
IM_C1
IM_C1
IM_C1
IM_C2
IM_C2
IM_C2
IM_C2
IM_C3
IM_C3
IM_C3
IM_C3
IM_C4
IM_C4
IM_C4
IM_C4""")
pt_8 = Point([Point(203, -37, 14), Point(207, -37, 14), Point(203, -33, 14), Point(207, -33, 14), Point(199, -41, 10), Point(211, -41, 10), Point(199, -29, 10), Point(211, -29, 10), Point(199, -41, 6), Point(211, -41, 6), Point(199, -29, 6), Point(211, -29, 6), Point(203, -37, 2), Point(207, -37, 2), Point(203, -33, 2), Point(207, -33, 2)])
crv_8 = Curve([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])
geo_15 = Geometry(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)
conndir_8 = Wasp_ConnectionFromDirection(GEO=geo_15, CEN=pt_8, UP=crv_8, T=panel_13)  # -> CONN, PLN_OUT; inputs CEN: list of Point3d, UP: list of Curve, T: list; plug-in component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
attribute_8 = Wasp_Attribute(ID="CORE", VAL=geo_14, TR=Toggle(True))  # -> ATTR; inputs VAL: list, TR: Boolean; plug-in component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
part_8 = Wasp_BasicPart(NAME="IM_C", GEO=geo_15, CONN=flatten(conndir_8.CONN), ATTR=attribute_8)  # -> PART; inputs GEO: Mesh, CONN: list, ATTR: list; plug-in component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

geo_16 = Geometry(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)

# ----
# Infrastructure
# Module 1
# 14
geo_17 = Geometry(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)
panel_14 = Panel("""IM_A1
IM_A1
IM_A1
IM_A1
IM_Atop
IM_Abot""")
pt_9 = Point([Point(205, 1, 4), Point(201, 5, 4), Point(209, 5, 4), Point(205, 9, 4), Point(205, 5, 8), Point(205, 5, 0)])
crv_9 = Curve([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])
conndir_9 = Wasp_ConnectionFromDirection(GEO=geo_17, CEN=pt_9, UP=crv_9, T=panel_14)  # -> CONN, PLN_OUT; inputs CEN: list of Point3d, UP: list of Curve, T: list; plug-in component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
attribute_9 = Wasp_Attribute(ID="INF_Single", VAL=geo_16, TR=Toggle(True))  # -> ATTR; inputs VAL: list, TR: Boolean; plug-in component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
part_9 = Wasp_BasicPart(NAME="IM_A", GEO=geo_17, CONN=flatten(conndir_9.CONN), ATTR=attribute_9)  # -> PART; inputs GEO: Mesh, CONN: list, ATTR: list; plug-in component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

# ----
# VISUALIZATION
panel_15 = Panel("LIVING1")

# ----
# Rule Grammars (Example)
panel_16 = Panel("""CEN_TOP>POD_A
CEN_TOP>HOR_A
CEN_TOP>HOR_B
CEN_TOP>LIF_A
CEN_MID>POD_A
CEN_MID>HOR_A
CEN_MID>HOR_B
CEN_BOT>POD_A
CEN_BOT>HOR_A
CEN_BOT>HOR_B
CEN_BOT>FCT_A
FOD_A>POD_A
FOD_A>HOR_A
FOD_A>LIF_A
FOD_A>LIF_B
FOD_A>FCT_A
FOD_A>FCT_B
FOD_B>DOC_A
FOD_B>POD_A
FOD_B>HOR_B
FOD_B>FCT_B
FOD_B>LIF_A
FOD_B>LIF_B
DOC_A>FOD_B
DOC_A>POD_A
DOC_A>HOR_B
DOC_A>VER_MID
DOC_A>FCT_B
DOC_A>FCT_A
DOC_A>LIF_B
POD_A>POD_A
POD_A>FOD_A
POD_A>FOD_B
POD_A>DOC_A
POD_A>HOR_A
POD_A>HOR_B
POD_A>FCT_A
POD_A>FCT_B
POD_A>VER_TOP
POD_A>VER_BOT
HOR_A>FOD_A
HOR_A>POD_A
HOR_A>HOR_B
HOR_A>VER_TOP
HOR_A>VER_MID
HOR_A>VER_BOT
HOR_A>LIF_A
HOR_A>LIF_B
HOR_A>FCT_A
HOR_A>FCT_B
HOR_A>CEN_TOP
HOR_A>CEN_MID
HOR_A>CEN_BOT
HOR_B>FOD_B
HOR_B>POD_A
HOR_B>VER_TOP
HOR_B>VER_MID
HOR_B>VER_BOT
HOR_B>LIF_A
HOR_B>LIF_B
HOR_B>FCT_A
HOR_B>FCT_B
HOR_B>CEN_TOP
HOR_B>CEN_MID
HOR_B>CEN_BOT
VER_TOP>POD_A
VER_TOP>HOR_A
VER_TOP>HOR_B
VER_MID>POD_A
VER_MID>HOR_A
VER_MID>HOR_B
VER_BOT>POD_A
VER_BOT>HOR_A
VER_BOT>HOR_B
VER_BOT>FOD_A
VER_BOT>FCT_A
VER_BOT>LIF_B
FCT_A>POD_A
FCT_A>HOR_A
FCT_A>HOR_B
FCT_B>POD_A
FCT_B>HOR_A
FCT_B>HOR_B
FCT_B>FOD_B
LIF_A>FOD_B
LIF_A>DOC_A
LIF_A>POD_A
LIF_A>HOR_A
LIF_A>HOR_B
LIF_A>LIF_B
LIF_A>CEN_TOP
LIF_B>FOD_B
LIF_B>DOC_A
LIF_B>POD_A
LIF_B>HOR_A
LIF_B>HOR_B
LIF_B>LIF_A
VER_SUP>SUP_A
SUP_A>VER_SUP
FOD_SUP>SUP_B
SUP_B>FOD_SUP
VER_POW>POW_A
POW_A>VER_POW""")
number_slider = Slider(1, range=0..3)

# ----
# STOCHASTIC
# AGGREGATION
# Stochastic Aggregation
merge_2 = Merge(
    Data1=part_2,
    Data2=part,
    Data4=part_4,
    Data5=part_3,
    Data6=part_5,
    Data7=part_6,
    Data8=part_9,
    Data9=part_7,
    Data10=part_8)

# ----
# Assembly Ratios
boolean_toggle = BooleanToggle(False)
panel_17 = Panel(data)
partcat = Wasp_PartsCatalog(PART=flatten(merge_2), NUM=panel_17, LIM=boolean_toggle, AD=Toggle(False))  # -> CAT; inputs PART: list, NUM: list, LIM: Boolean, AD: Boolean; plug-in component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

rulegen = Wasp_RulesGenerator(PART=merge_2, SELF_P=Toggle(True))  # -> R; inputs PART: list, SELF_P: Boolean, SELF_C: Boolean, TYP: Boolean, GR: list; plug-in component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

stochasticaggregation = Wasp_StochasticAggregation(PART=flatten(merge_2), PREV=part_2, N=population_of_modules, RULES=rulegen, CAT=partcat, MODE="1", RESET=recompute)  # -> AGGR, PART_OUT; inputs PART: list, PREV: list, N: Int32, RULES: list, SEED: Int32, MODE: Int32, GC: list, RESET: Boolean; plug-in component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

getattr = Wasp_GetAttributeByName(PART=stochasticaggregation.PART_OUT, ID="BRIDGE")  # -> VAL; plug-in component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
getattr_2 = Wasp_GetAttributeByName(PART=stochasticaggregation.PART_OUT, ID="CORE")  # -> VAL; plug-in component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
getattr_3 = Wasp_GetAttributeByName(PART=stochasticaggregation.PART_OUT, ID="INF_Single")  # -> VAL; plug-in component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
getattr_4 = Wasp_GetAttributeByName(PART=stochasticaggregation.PART_OUT, ID="GREENHOUSE3")  # -> VAL; plug-in component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
getattr_5 = Wasp_GetAttributeByName(PART=stochasticaggregation.PART_OUT, ID=panel_15)  # -> VAL; plug-in component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
getattr_6 = Wasp_GetAttributeByName(PART=stochasticaggregation.PART_OUT, ID="LIVING2")  # -> VAL; plug-in component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
getattr_7 = Wasp_GetAttributeByName(PART=stochasticaggregation.PART_OUT, ID="SPORTREC1")  # -> VAL; plug-in component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
getattr_8 = Wasp_GetAttributeByName(PART=stochasticaggregation.PART_OUT, ID="SPORTREC2")  # -> VAL; plug-in component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
getattr_9 = Wasp_GetAttributeByName(PART=stochasticaggregation.PART_OUT, ID="GREENHOUSE1")  # -> VAL; plug-in component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
getattr_10 = Wasp_GetAttributeByName(PART=stochasticaggregation.PART_OUT, ID="GREENHOUSE2")  # -> VAL; plug-in component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

# ---- group: RH_OUT: Living1
mesh = Mesh(getattr_5)

# ---- group: RH_OUT: Living2
mesh_2 = Mesh(getattr_6)

# ---- group: RH_OUT: SportRec
mesh_3 = Mesh([getattr_7, getattr_8])

# ---- group: RH_OUT: Greehouse
mesh_4 = Mesh([getattr_9, getattr_10, getattr_4])

# ---- group: RH_OUT: INF_Single
mesh_5 = Mesh(getattr_3)

# ---- group: RH_OUT: Bridge
mesh_6 = Mesh(getattr)

# ---- group: RH_OUT: Core
mesh_7 = Mesh(getattr_2)

# ----
getattr_11 = Wasp_GetAttributeByName(PART=stochasticaggregation.PART_OUT, ID="WORKING2")  # -> VAL; plug-in component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
getattr_12 = Wasp_GetAttributeByName(PART=stochasticaggregation.PART_OUT, ID="WORKING1")  # -> VAL; plug-in component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

# ---- group: RH_OUT: Working
mesh_8 = Mesh([getattr_12, getattr_11])
