# Grasshopper definition k_means_module_02.gh (Grasshopper 1.0.7)
# plug-ins: Weaverbird

mesh = Mesh(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)
mesh_edges = MeshEdges(Mesh=mesh)  # -> NakedEdges, InteriorEdges, NonManifoldEdges
bounding_box = BoundingBox(Content=mesh, Plane=PlaneXY(0, 0, 0))  # -> Box, Box_2
deconstruct_brep = DeconstructBrep(Brep=bounding_box.Box)  # -> Faces, Edges, Vertices
bounding_box_2 = BoundingBox(Content=mesh, Plane=PlaneXY(0, 0, 0))  # -> Box, Box_2
join_curves = JoinCurves(Curves=mesh_edges.NakedEdges, Preserve=False)  # -> flatten(Curves)
list_item = ListItem(List=deconstruct_brep.Edges, Index=Slider(1, range=0..10), Wrap=True)
deconstruct_brep_2 = DeconstructBrep(Brep=bounding_box_2.Box)  # -> Faces, Edges, Vertices
list_item_2 = ListItem(List=join_curves, Index=Slider(3, range=0..10), Wrap=True)
length = Length(Curve=list_item)
num_y = GetNumber(Slider(5, range=0..10), AtLeast=1, AtMost=2147483647, Maximum=1.797693135e+308, Minimum=-1.797693135e+308)
num_z = GetNumber(Slider(3, range=0..10), AtLeast=1, AtMost=2147483647, Maximum=1.797693135e+308, Minimum=-1.797693135e+308)
num_x = GetNumber(Slider(3, range=0..10), AtLeast=1, AtMost=2147483647, Maximum=1.797693135e+308, Minimum=-1.797693135e+308)
list_item_3 = ListItem(List=deconstruct_brep_2.Edges, Index=0, Wrap=True)
area = Area(Geometry=list_item_2)  # -> Area, Centroid
plane_normal = PlaneNormal(Origin=area.Centroid, ZAxis=Vector(0, 0, 1))
series = Series(Start=0, Step=length, Count=num_x)
series_2 = Series(Start=0, Step=length, Count=num_y)
series_3 = Series(Start=0, Step=length, Count=num_z)
unit_y = UnitY(Factor=series)
point = Point(Point(0.4583045624, 0.4992395957, 0.9298587835))
move = Move(Geometry=point, Motion=unit_y)  # -> Geometry, Transform
unit_x = UnitX(Factor=series_2)
cross_reference = CrossReference(ListListA=move.Geometry, ListListB=unit_x, CrossMode=1)  # -> ListListA, ListListB
unit_z = UnitZ(Factor=series_3)
move_2 = Move(Geometry=cross_reference.ListListA, Motion=cross_reference.ListListB)  # -> Geometry, Transform
number_slider = Slider(0.6, range=0..1)
cross_reference_2 = CrossReference(ListListA=move_2.Geometry, ListListB=unit_z, CrossMode=1)  # -> ListListA, ListListB
move_3 = Move(Geometry=cross_reference_2.ListListA, Motion=cross_reference_2.ListListB)  # -> Geometry, Transform
reduction = GetNumber(Slider(27, range=0..100), AtLeast=1, AtMost=2147483647, Maximum=1.797693135e+308, Minimum=-1.797693135e+308)
list_length = ListLength(List=move_3.Geometry)
seed = GetNumber(Slider(7, range=0..20), AtLeast=1, AtMost=2147483647, Maximum=1.797693135e+308, Minimum=-1.797693135e+308)
random_reduce = RandomReduce(List=move_3.Geometry, Reduction=reduction, Seed=seed)
plane_normal_2 = PlaneNormal(Origin=random_reduce, ZAxis=Vector(0, 0, 1))
orient = Orient(Geometry=mesh, Source=plane_normal, Target=plane_normal_2)  # -> Geometry, Transform
int_k = GetNumber(Slider(20, range=0..100), AtLeast=1, AtMost=2147483647, Maximum=1.797693135e+308, Minimum=-1.797693135e+308)
flatten_tree = FlattenTree(Tree=orient.Geometry, Path="{0}")
area_2 = Area(Geometry=orient.Geometry)  # -> Area, Centroid
mesh_join = MeshJoin(Meshes=flatten_tree)
explode_mesh = GhPythonScript(M=mesh_join)  # -> M
# ---------- explode_mesh: Python ----------
import Rhino

def meshFromMeshFaces(mesh):
    meshList = []
    for i, face in enumerate(mesh.Faces):

        new_mesh = Rhino.Geometry.Mesh()

        new_mesh.Vertices.Add(mesh.Vertices[face[0]])
        new_mesh.Vertices.Add(mesh.Vertices[face[1]])
        new_mesh.Vertices.Add(mesh.Vertices[face[2]])
        if face.IsQuad: new_mesh.Vertices.Add(mesh.Vertices[face[3]])
        if face.IsTriangle:
            new_mesh.Faces.AddFace(0, 1, 2)
        else:
            new_mesh.Faces.AddFace(0, 1, 2, 3)
        
        new_mesh.Normals.ComputeNormals()
        meshList.append(new_mesh)
    return meshList
    
M = meshFromMeshFaces(M)
# ---------- end explode_mesh ----------
panel = Panel(flatten_tree)
series_4 = Series(Start=0, Step=1, Count=int_k)
k_means = GhPythonScript(M=flatten(explode_mesh), K=int_k)  # -> out, clusterIndexes; inputs M: list of Mesh, K: Int32
# ---------- k_means: Python ----------
import Rhino.Geometry as rg
import random
import ghpythonlib.treehelpers as th 
import math

def ndistance(a, b):
    """Returns the distance between two n-dimensional vectors"""
    total = 0
    for i in range(len(a)):
        diff = b[i] - a[i]
        total += diff **2
    return math.sqrt(total)

def findnearest(vecs, centroids):
    """Returns the nearest vector among a list of n-dimensional vectors"""
    
    vecs= [list(v[1]) for v in vecs]
    centroids = [list(c[1]) for c in centroids]
    clusters = [[] for c in centroids]
    for j,v in enumerate(vecs):
        closestDist = float("inf")
        closestIndex = 0
        for i,c in enumerate(centroids):
            dist = ndistance(v,c)
            if dist < closestDist : 
                closestDist = dist
                closestIndex = i
                
        clusters[closestIndex].append((j,v))
    clusters = [x for x in clusters if x != []]
    return clusters

def avgvecs(veclist):
    """Returns the avarage vector of a list of n-dimensional vectors"""
    
    veclist = [v[1] for v in veclist]
    trans = map(list, zip(*veclist))
    avgvec = []
    for i in range(len(trans)):
        avgvec.append( sum(trans[i]) / len(trans[i]))
    return (-1,avgvec)

#1. MAKE VECTORS TO ANALYZE ///////////////////////////////////////////////

#make a list where will will store all the n-dimensional vectors. It will be a list of lists
allVectors= []

#we iterate through every mesh with a for loop
for i in range(len(M)):
    #here make a list that will be our n-dimensional vector called nVector
    nVector  =[]

    #for every mesh, we get two lines from oposing vertices
    line1 = rg.Line(M[i].Vertices[0], M[i].Vertices[2])
    line2 = rg.Line(M[i].Vertices[1], M[i].Vertices[3])
    
    #then we store the length of those lines, as our first two dimentions of our nVector
    nVector.append(line1.Length) #dimension 1
    nVector.append(line2.Length) #dimension 2
    
    #next, we find the parameters where each of those lines intersect, per each of the lines
    lli = rg.Intersect.Intersection.LineLine(line1, line2)
    p1 = lli[1]
    p2 = lli[2]
    
    #then we store those parameters as third and fourth dimentions of our nVector
    nVector.append(p1) #third dimension
    nVector.append(p2) #fourth dimension

    #next, we want to get the angle between those vectors
    #for which we need to convert the lines to vectors to calculate the angle
    #we do this using vector substraction (https://www.dummies.com/education/science/physics/how-to-subtract-vectors/)
    v1 = line1.To - line1.From 
    v2 = line2.To - line2.From 
    
    #then, we get the angle from those two vectors
    ang = rg.Vector3d.VectorAngle(v1,v2)
    nVector.append(ang)
    
    allVectors.append(nVector) #append the nVector to a list of allVectors 



#2. K-MEANS ALGORTITHM ///////////////////////////////////////////////

#2.0 add indexes to every vector in the vector list, in order to identify them after clustering
allVectors = [ (i,v) for i,v in enumerate(allVectors) ] #this is called a list comprehension (look it up, if you are interested)

#2.1 find random indexes using random library 
random.seed(1) #we may want to keep the seed consistent, so that the number doesn´t change every time
K_list = random.sample(range(len(M)), K)

#2.2 find some initial random centroids within our ndimensional vectors
centroids = []
for k in K_list:
    centroids.append(allVectors[k])


#2.3 iterate until the condition in the end fulfils (see while loops)
while True:
    

    clusters = findnearest(allVectors, centroids) # findnearest function clusters nvectors to the nearest centroids, and returns a list of clustered nvectors
    
    #then we find new centroids, by averaging all of the vectors in a cluster
    new_centroids = []
    for cluster in clusters:
        
        new_centroid= avgvecs(cluster) #avgvecs function takes a list of nvectors and returns an average nvector
        new_centroids.append(new_centroid) #we store all of the new centroids in a new list of centroids

    #last, we replace the list of centroids, unless the centroids haven´t changed
    if new_centroids == centroids: break #exits the while loop if the new centroids are the same as the old ones
    else: centroids = new_centroids

#2.4 finally, we need to get the item from our nvector list, which will be the identifier for the meshface in the overall mesh
allIndexes = []
for cluster in clusters:
    cluster_indexes =[]
    for nvector in cluster:
        cluster_indexes.append(nvector[0])# we only need to append the index (item 0 of indexAndVector), not the nVector
    allIndexes.append(cluster_indexes)


#output the indexes
clusterIndexes = th.list_to_tree(allIndexes)
# ---------- end k_means ----------
item = ListItem(List=explode_mesh, Index=k_means.clusterIndexes, Wrap=True)
panel_2 = Panel(item)
gradient = Gradient(LowerLimit=0, UpperLimit=int_k, Parameter=series_4, stops=[0: RGB(255, 255, 255), 0.5: RGB(189, 4, 4), 1: RGB(0, 0, 0)])
tree_statistics = TreeStatistics(Tree=k_means.clusterIndexes)  # -> Paths, Length, Count
mcol = MeshColours(Mesh=item, Colours=graft(gradient))  # -> flatten(Mesh)
panel_3 = Panel(tree_statistics.Length)
tstat = TreeStatistics(Tree=k_means.clusterIndexes)  # -> Paths, Length, Count
proximity_3d = Proximity3D(Points=area_2.Centroid, Group=5)  # -> Links, Topology
area_3 = Area(Geometry=item)  # -> Area, Centroid
argb = SplitARGB(Colour=graft(gradient), IntegerChannels=True)  # -> Alpha, Red, Green, Blue

# ---- group: RH_OUT:int_cluster_lengths
int = Integer(tstat.Length)

# ----
mass_addition = MassAddition(Input=area_3.Area)  # -> Result, PartialResults
dash_pattern = DashPattern(Curve=reparameterize(proximity_3d.Links), Pattern=Slider(0.0548, range=0..1))  # -> Dashes, Gaps
merge = Merge(Data1=argb.Red, Data2=argb.Green, Data3=argb.Blue)
join = TextJoin(Text=[argb.Red, argb.Green, argb.Blue], Join=",")  # -> flatten(Result)
mjoin = MeshJoin(Meshes=mcol)
number = Number(mass_addition.Result)

# ---- group: RH_OUT:curves_nodes
curve = Curve(dash_pattern.Dashes)

# ----
ghpython_script = GhPythonScript(crv=mjoin, color=graft(gradient))  # -> out, A; inputs crv: Mesh, color: Color; disabled
# ---------- ghpython_script: Python ----------
import rhinoscriptsyntax as rs

c = str(color.R) + "," + str(color.G) + "," + str(color.B)

#c = str(color.R)
#print(type(c))

crv.SetUserString("ID_color", c)

A = crv
# ---------- end ghpython_script ----------

# ---- group: RH_OUT:int_colors
int_2 = Integer(simplify(merge))

# ---- group: RH_OUT:str_colors
txt = Text(join)

# ----
list_length_2 = ListLength(List=area_3.Centroid)
flatten_tree_2 = FlattenTree(Tree=number, Path="{0}")
panel_4 = Panel(int_2)
weaverbird_s_mesh_thicken = WeaverbirdsMeshThicken(MeshCurves=mjoin, Distance=Slider(0.0752, range=0..1), OffsetType=0)
mass_addition_2 = MassAddition(Input=flatten_tree_2)  # -> Result, PartialResults
flatten_tree_3 = FlattenTree(Tree=list_length_2, Path="{0}")
mass_addition_3 = MassAddition(Input=flatten_tree_3)  # -> Result, PartialResults
expression = Expression(x=mass_addition_2.Result, y=Slider(2, range=0..10), Expression="Round(x,y)")

# ---- group: RH_OUT:mesh_m
mesh_2 = Mesh(flatten(weaverbird_s_mesh_thicken))

# ---- group: RH_OUT:panels_length
data = Data(mass_addition_3.Result)

# ---- group: RH_OUT:kmeans_data
data_2 = Data(expression)

# ----
panel_5 = Panel(data)
deconstruct_mesh = DeconstructMesh(Mesh=flatten_tree)  # -> Vertices, Faces, Colours, Normals
panel_6 = Panel(expression)
face_normals = FaceNormals(Mesh=flatten_tree)  # -> Centers, Normals
panel_7 = Panel(data_2)
deconstruct_vector = DeconstructVector(Vector=face_normals.Normals)  # -> XComponent, YComponent, ZComponent
multiplication = Multiplication(A=deconstruct_vector.YComponent, B=Slider(255, range=0..1000))
multiplication_2 = Multiplication(A=deconstruct_vector.YComponent, B=Slider(255, range=0..1000))
multiplication_3 = Multiplication(A=deconstruct_vector.YComponent, B=Slider(255, range=0..1000))
colour_rgb = ColourRGB(Alpha=Slider(119, range=0..1000), Red=multiplication, Green=multiplication_2, Blue=multiplication_3)
construct_mesh = ConstructMesh(Vertices=deconstruct_mesh.Vertices, Faces=deconstruct_mesh.Faces, Colours=colour_rgb)
flatten_tree_4 = FlattenTree(Tree=construct_mesh, Path="{0}")
list_length_3 = ListLength(List=flatten_tree_4)
repeat_data = RepeatData(Data="255,255,255", Length=list_length_3)
ghpython_script_2 = GhPythonScript(crv=flatten_tree_4, color=repeat_data)  # -> out, A; inputs crv: Mesh, color: Color; disabled; same code as ghpython_script
weaverbird_s_picture_frame = WeaverbirdsPictureFrame(MeshPolylines=flatten_tree_4, Distance=Slider(13.784, range=0..100), InsetType=0)
mesh_join_2 = MeshJoin(Meshes=weaverbird_s_picture_frame)
number_slider_2 = Slider(30, range=0..100)
weaverbird_s_mesh_thicken_2 = WeaverbirdsMeshThicken(MeshCurves=mesh_join_2, Distance=Slider(0.299, range=0..1), OffsetType=0)
mesh_sphere = MeshSphere(Base=area_2.Centroid, Radius=Slider(3.35, range=0..10), UCount=number_slider_2, VCount=number_slider_2)
flatten_tree_5 = FlattenTree(Tree=mesh_sphere, Path="{0}")

# ---- group: RH_OUT:mesh_frame
mesh_3 = Mesh(flatten(weaverbird_s_mesh_thicken_2))

# ----
list_length_4 = ListLength(List=flatten_tree_5)
repeat_data_2 = RepeatData(Data="48,48,48", Length=list_length_4)
ghpython_script_3 = GhPythonScript(crv=flatten_tree_5, color=repeat_data_2)  # -> out, A; inputs crv: Mesh, color: Color; same code as ghpython_script

# ---- group: RH_OUT:mesh_sphere
mesh_4 = Mesh(ghpython_script_3.A)
