# Grasshopper definition wasp_example.gh (Grasshopper 1.0.7)

# ----
# 1_05_Rules_From_Aggregation
updatefile = Wasp_UpdateFile(UPDATE=Button())  # -> LOG; inputs UPDATE: Boolean; plug-in component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

single = GetNumber(Slider(20, range=1..50), AtLeast=1, AtMost=1, Maximum=50, Minimum=1, Prompt="Single")

crv = Curve([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])
# # Wasp: Discrete Design with Grasshopper plug-in (GPL) initiated by Andrea Rossi
# 
# 
# This file is part of Wasp.
# 
# Copyright (c) 2021, Andrea Rossi <a.rossi.andrea@gmail.com>
# 
# Wasp is free software; you can redistribute it and/or modify it under the terms of the GNU General Public License as published by the Free Software Foundation; either version 3 of the License, or (at your option) any later version.
# 
# Wasp is distributed in the hope that it will be useful, but WITHOUT ANY WARRANTY; without even the implied warranty of MERCHANTABILITY or FITNESS FOR A PARTICULAR PURPOSE. See the GNU General Public License for more details. You should have received a copy of the GNU General Public License
#  along with Wasp; If not, see <http://www.gnu.org/licenses/>.
# 
# license GPL-3.0 <https://www.gnu.org/licenses/gpl.html>
# 
# Significant parts of Wasp have been developed by Andrea Rossi as part of research on digital materials and discrete design at DDU Digital Design Unit - Prof. Oliver Tessmann - Technische Universität Darmstadt
geo = Geometry(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)
pt = Point([Point(-7.5, -4.330127019, 5), Point(0, -8.660254038, 5), Point(7.5, -4.330127019, 5), Point(7.5, 4.330127019, 5), Point(0, 8.660254038, 5), Point(-7.5, 4.330127019, 5)])
geo_2 = Geometry(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)
geo_3 = Geometry(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)
debrep = DeconstructBrep(Brep=geo)  # -> Faces, Edges, Vertices
item = ListItem(List=debrep.Faces, Index=Slider(6, range=0..10), Wrap=True)  # -> Item, Item1
area = Area(Geometry=item.Item1)  # -> Area, Centroid
Y = UnitY(Factor=1)
attribute = Wasp_Attribute(ID="BLOCK", VAL=geo_2, TR=Toggle(True))  # -> ATTR; inputs VAL: list, TR: Boolean; plug-in component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
attribute_2 = Wasp_Attribute(ID="WIN", VAL=geo_3, TR=Toggle(True))  # -> ATTR; inputs VAL: list, TR: Boolean; plug-in component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
panel = Panel("""0
120
240""")
line = LineSDL(Start=area.Centroid, Direction=Y, Length=1)
area_2 = Area(Geometry=item.Item)  # -> Area, Centroid
Y_2 = UnitY(Factor=1)
line_2 = LineSDL(Start=area_2.Centroid, Direction=Y_2, Length=1)
lng = ListLength(List=panel)
rotate = Rotate(Geometry=line, Angle=degrees(panel), Plane=area.Centroid)  # -> Geometry, Transform
repeat = RepeatData(Data=area.Centroid, Length=lng)
conndir = Wasp_ConnectionFromDirection(GEO=geo, CEN=pt, UP=crv, T="SIDE")  # -> CONN, PLN_OUT; inputs CEN: list of Point3d, UP: list of Curve, T: list; plug-in component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
conndir_2 = Wasp_ConnectionFromDirection(GEO=geo, CEN=area_2.Centroid, UP=line_2, T="BOTTOM")  # -> CONN, PLN_OUT; inputs CEN: list of Point3d, UP: list of Curve, T: list; plug-in component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
conndir_3 = Wasp_ConnectionFromDirection(GEO=geo, CEN=repeat, UP=rotate.Geometry, T="TOP")  # -> CONN, PLN_OUT; inputs CEN: list of Point3d, UP: list of Curve, T: list; plug-in component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
merge = Merge(Data1=flatten(conndir.CONN), Data2=flatten(conndir_2.CONN), Data3=flatten(conndir_3.CONN))
part = Wasp_BasicPart(NAME="HEXA", GEO=geo, CONN=flatten(merge), ATTR=[attribute, attribute_2])  # -> PART; inputs GEO: Mesh, CONN: list, ATTR: list; plug-in component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

crv_2 = Curve([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])
pt_2 = Point([Point(-7.5, -4.330127019, 5), Point(0, -8.660254038, 5), Point(7.5, -4.330127019, 5), Point(7.5, 4.330127019, 5), Point(0, 8.660254038, 5), Point(-7.5, 4.330127019, 5)])
geo_4 = Geometry(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)
geo_5 = Geometry(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)
debrep_2 = DeconstructBrep(Brep=geo_4)  # -> Faces, Edges, Vertices
geo_6 = Geometry(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)
item_2 = ListItem(List=debrep_2.Faces, Index=single, Wrap=True)  # -> Item, Item1
area_3 = Area(Geometry=item_2.Item1)  # -> Area, Centroid
Y_3 = UnitY(Factor=1)
attribute_3 = Wasp_Attribute(ID="BLOCK", VAL=geo_5, TR=Toggle(True))  # -> ATTR; inputs VAL: list, TR: Boolean; plug-in component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
attribute_4 = Wasp_Attribute(ID="WIN", VAL=geo_6, TR=Toggle(True))  # -> ATTR; inputs VAL: list, TR: Boolean; plug-in component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
panel_2 = Panel("""0
90
180""")
line_3 = LineSDL(Start=area_3.Centroid, Direction=Y_3, Length=1)
subset = SubList(List=debrep_2.Faces, Domain=Slider(5, range=0..10), Wrap=True)  # -> List, Index
area_4 = Area(Geometry=item_2.Item)  # -> Area, Centroid
Y_4 = UnitY(Factor=1)
Z = UnitZ(Factor=1)
area_5 = Area(Geometry=subset.List)  # -> Area, Centroid
line_4 = LineSDL(Start=area_4.Centroid, Direction=Y_4, Length=1)
lng_2 = ListLength(List=panel_2)
rotate_2 = Rotate(Geometry=line_3, Angle=degrees(panel_2), Plane=area_3.Centroid)  # -> Geometry, Transform
line_5 = LineSDL(Start=area_5.Centroid, Direction=Z, Length=1)
repeat_2 = RepeatData(Data=area_3.Centroid, Length=lng_2)
conndir_4 = Wasp_ConnectionFromDirection(GEO=geo_4, CEN=area_4.Centroid, UP=line_4, T="BOTTOM")  # -> CONN, PLN_OUT; inputs CEN: list of Point3d, UP: list of Curve, T: list; plug-in component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
conndir_5 = Wasp_ConnectionFromDirection(GEO=geo_4, CEN=area_5.Centroid, UP=line_5, T="SIDE")  # -> CONN, PLN_OUT; inputs CEN: list of Point3d, UP: list of Curve, T: list; plug-in component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
conndir_6 = Wasp_ConnectionFromDirection(GEO=geo_4, CEN=repeat_2, UP=rotate_2.Geometry, T="TOP")  # -> CONN, PLN_OUT; inputs CEN: list of Point3d, UP: list of Curve, T: list; plug-in component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
merge_2 = Merge(Data1=flatten(conndir_5.CONN), Data2=flatten(conndir_4.CONN), Data3=flatten(conndir_6.CONN))
part_2 = Wasp_BasicPart(NAME="LBLOCK", GEO=geo_4, CONN=flatten(merge_2), ATTR=[attribute_3, attribute_4])  # -> PART; inputs GEO: Mesh, CONN: list, ATTR: list; plug-in component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

# ----
# Transformed Base Part using non-uniform scaling
number_slider = Slider(1.79, range=0..10)
volume = Volume(Geometry=geo)  # -> Volume, Centroid
scale_nu = ScaleNU(Plane=volume.Centroid, ScaleX=number_slider, ScaleY=Slider(0.46, range=0..10), ScaleZ=Slider(1, range=0..10))  # -> Geometry, Transform
parttr = Wasp_TransformPart(PART=part, TR=scale_nu.Transform)  # -> PART_OUT; inputs TR: Transform; plug-in component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
partgeo = Wasp_GetPartGeometry(PART=parttr)  # -> GEO; plug-in component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

# ----
# Base Aggregation
panel_3 = Panel("""SIDE>SIDE
TOP>BOTTOM
BOTTOM>TOP""")
rulegen = Wasp_RulesGenerator(PART=part, GR=panel_3)  # -> R; inputs PART: list, SELF_P: Boolean, SELF_C: Boolean, TYP: Boolean, GR: list; plug-in component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
stochasticaggregation = Wasp_StochasticAggregation(PART=flatten(part), N=Slider(100, range=0..1000), RULES=rulegen, RESET=Button())  # -> AGGR, PART_OUT; inputs PART: list, PREV: list, N: Int32, RULES: list, SEED: Int32, MODE: Int32, GC: list, RESET: Boolean; plug-in component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
data = Data(stochasticaggregation.PART_OUT)

# ----
# The Rules from Aggregation component also allow to modify
# the generated rules sequence, by replacing the name of one
# part with another one.
# This allows to re-create the same aggregation using completely
# different parts, having the same topology as the base parts,
# but different geometry.
panel_4 = Panel("HEXA")
graphrules = Wasp_RulesFromAggregation(AGGR=stochasticaggregation.AGGR, ON=panel_4, NN="LBLOCK")  # -> GR, PREV; inputs ON: list, NN: list; plug-in component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
panel_5 = Panel(graphrules.GR)
graphaggr = Wasp_GraphGrammarAggregation(PART=flatten(part_2), RULES=graphrules.GR, RESET=Toggle(True))  # -> AGGR, PART_OUT; inputs PART: list, PREV: list, RULES: list, RESET: Boolean; plug-in component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

# ----
# Using the Rules from Aggregation component it is possible
# to extract the rules sequence that created one aggregation.
# This sequence can then be used in a Graph-Grammar Aggregation
# process to recreate the aggregation.
# When recreating the aggregation, it is possible to modify the base
# part using the Transform Part component before aggregating.
graphrules_2 = Wasp_RulesFromAggregation(AGGR=stochasticaggregation.AGGR)  # -> GR, PREV; inputs ON: list, NN: list; plug-in component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
panel_6 = Panel(graphrules_2.GR)
graphaggr_2 = Wasp_GraphGrammarAggregation(PART=flatten(parttr), RULES=graphrules_2.GR, RESET=Toggle(True))  # -> AGGR, PART_OUT; inputs PART: list, PREV: list, RULES: list, RESET: Boolean; plug-in component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

getattr = Wasp_GetAttributeByName(PART=data, ID="BLOCK")  # -> VAL; plug-in component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
getattr_2 = Wasp_GetAttributeByName(PART=data, ID="WIN")  # -> VAL; plug-in component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

preview = CustomPreview(Geometry=getattr, Material=ColourSwatch(SwatchColor=RGB(255, 255, 255)))
preview_2 = CustomPreview(Geometry=getattr_2, Material=ColourSwatch(SwatchColor=RGBA(0, 255, 225, 97)))

X = UnitX(Factor="500")
move = Move(Motion=X)  # -> Geometry, Transform
parttr_2 = Wasp_TransformPart(PART=graphaggr.PART_OUT, TR=move.Transform)  # -> PART_OUT; inputs TR: Transform; plug-in component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
data_2 = Data(parttr_2)
getattr_3 = Wasp_GetAttributeByName(PART=data_2, ID="BLOCK")  # -> VAL; plug-in component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
getattr_4 = Wasp_GetAttributeByName(PART=data_2, ID="WIN")  # -> VAL; plug-in component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
preview_3 = CustomPreview(Geometry=getattr_3, Material=ColourSwatch(SwatchColor=RGB(255, 255, 255)))
preview_4 = CustomPreview(Geometry=getattr_4, Material=ColourSwatch(SwatchColor=RGBA(0, 255, 225, 97)))

X_2 = UnitX(Factor="250")
move_2 = Move(Motion=X_2)  # -> Geometry, Transform
parttr_3 = Wasp_TransformPart(PART=graphaggr_2.PART_OUT, TR=move_2.Transform)  # -> PART_OUT; inputs TR: Transform; plug-in component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
data_3 = Data(parttr_3)
getattr_5 = Wasp_GetAttributeByName(PART=data_3, ID="WIN")  # -> VAL; plug-in component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
getattr_6 = Wasp_GetAttributeByName(PART=data_3, ID="BLOCK")  # -> VAL; plug-in component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
preview_5 = CustomPreview(Geometry=getattr_6, Material=ColourSwatch(SwatchColor=RGB(255, 255, 255)))
preview_6 = CustomPreview(Geometry=getattr_5, Material=ColourSwatch(SwatchColor=RGBA(0, 255, 225, 97)))

# ---- group: RH_OUT: Greehouse
mesh = Mesh(getattr_3)

# ---- group: RH_OUT: Greehouse_b
mesh_2 = Mesh(getattr_4)
